# Dynamo graph script.dyn "Hide-Unhide Engineer Notes" (Dynamo 2.19.3.6394)
# packages: archi-lab.net 2023.213.1722

# group: DYNAMO KL&A
# note: DESCRIPTION:
# Script hides or unhides engineer notes and symbol
# CREATED BY:
# ALAN FERRIN
# LAST EDITED:
# Created: 09.20.2019
# Modified: 08.27.2025
# note: DYNAMO VERSION:
# 2.0+
# WORKING REVIT VERSIONS(S):
# 2022+
# PACKAGES/ASSOCIATED EXCEL FILES:
# archi-lab.net

view_type = ViewTypesUi("EngineeringPlan")
getByType = archilab.Revit.Views.Views.GetByType(viewType=view_type)
view_type_2 = ViewTypesUi("Legend")
getByType_2 = archilab.Revit.Views.Views.GetByType(viewType=view_type_2)
view_type_3 = ViewTypesUi("DraftingView")
getByType_3 = archilab.Revit.Views.Views.GetByType(viewType=view_type_3)
view_type_4 = ViewTypesUi("Detail")
getByType_4 = archilab.Revit.Views.Views.GetByType(viewType=view_type_4)
view_type_5 = ViewTypesUi("Schedule")
getByType_5 = archilab.Revit.Views.Views.GetByType(viewType=view_type_5)

# group: Select All Views
create = List.Create(item0=getByType, item1=getByType_2, item2=getByType_3, item3=getByType_4, item4=getByType_5)

unhide_false_hide_true = BoolSelector(true)  # graph input

# group: Select All Families "URL_KLAA_17GA"
categories = Categories("OST_GenericAnnotation")
all_elements_of_category = ElementsOfCategory(Category=categories)
code_block = CodeBlock { "URL_KLAA_17GA"; }
name = FamilyType.Name(familyType=all_elements_of_category)
eq = code_block == name
filterByBoolMask = List.FilterByBoolMask(list=all_elements_of_category, mask=eq)
filterByBoolMask_2 = List.FilterByBoolMask(list=filterByBoolMask.in, mask=unhide_false_hide_true, lacing=Longest)
flatten = List.Flatten(list=filterByBoolMask_2.in)
flatten_2 = List.Flatten(list=filterByBoolMask_2.out)

hideElements = archilab.Revit.Views.Views.HideElements(view=create, elements=flatten)
unHideElements = archilab.Revit.Views.Views.UnHideElements(view=create, elements=flatten_2)
list_selector = ListSelector()  # unwired: List

# group: Select All Text Styles "KLAA - ENGINEER'S NOTE"
element_types = ElementTypes("TextNote")
all_elements_of_type = ElementsOfType(element_type=element_types)
name_2 = FamilyType.Name(familyType=all_elements_of_type)
string = StringInput("KLAA - ENGINEER'S NOTE")
startsWith = String.StartsWith(string=name_2, searchFor=string)
filterByBoolMask_3 = List.FilterByBoolMask(list=all_elements_of_type, mask=startsWith)
filterByBoolMask_4 = List.FilterByBoolMask(list=filterByBoolMask_3.in, mask=unhide_false_hide_true, lacing=Longest)
flatten_3 = List.Flatten(list=filterByBoolMask_4.out)
flatten_4 = List.Flatten(list=filterByBoolMask_4.in)

unHideElements_2 = archilab.Revit.Views.Views.UnHideElements(view=create, elements=flatten_3)
# note: Hide or Unhide
hideElements_2 = archilab.Revit.Views.Views.HideElements(view=create, elements=flatten_4)
